# Grasshopper definition perlin noise maze.gh (Grasshopper 1.0.7)
# plug-ins: Noise 4D, Parakeet, Shortest Walk in Gh, MeshEdit Components, Kangaroo2 Components, treesloth01

# ---- group: RH_IN:seed
maze_seed = Slider(30, range=0..100)

# ---- group: RH_IN:tube
radius_of_tube = Slider(0.3, range=0..1)

# ---- group: RH_IN:count
count = Slider(33, range=1..100)

# ---- group: RH_IN:scale
perlin_scale = Slider(0.07, range=0..0.1)

# ---- group: RH_IN: radius
radius = Slider(14, range=1..100)

# ---- group: RH_IN:time
perlin_time = Slider(1.73, range=0..10)

# ----
seed = GetNumber(maze_seed, AtLeast=1, AtMost=1, Maximum=1.797693135e+308, Minimum=-1.797693135e+308)
tube = GetNumber(radius_of_tube, AtLeast=1, AtMost=1, Maximum=1.797693135e+308, Minimum=-1.797693135e+308)
time = GetNumber(perlin_time, AtLeast=1, AtMost=1, Maximum=1.797693135e+308, Minimum=-1.797693135e+308)
radius_2 = GetNumber(radius, AtLeast=1, AtMost=1, Maximum=1.797693135e+308, Minimum=-1.797693135e+308)
count_2 = GetNumber(count, AtLeast=1, AtMost=1, Maximum=1.797693135e+308, Minimum=-1.797693135e+308)
scale = GetNumber(perlin_scale, AtLeast=1, AtMost=1, Maximum=1.797693135e+308, Minimum=-1.797693135e+308)
point = Point(Point(91.62038101, 21.3851803, 0))
mesh_sphere = MeshSphere(Base=point, Radius=radius_2, UCount=count_2, VCount=count_2)
clean = CombineClean(Meshes=mesh_sphere)
deconstruct_mesh = DeconstructMesh(Mesh=clean)  # -> Vertices, Faces, Colours, Normals
perlinnoise = PerlinNoise(Values=deconstruct_mesh.Vertices, Time=time, Scale=scale)
multiplication = Multiplication(A=deconstruct_mesh.Normals, B=perlinnoise)
multiplication_2 = Multiplication(A=multiplication, B=Slider(6, range=0..100))
move = Move(Geometry=deconstruct_mesh.Vertices, Motion=multiplication_2)  # -> Geometry, Transform
colour = Colour(deconstruct_mesh.Normals)
construct_mesh = ConstructMesh(Vertices=move.Geometry, Faces=deconstruct_mesh.Faces, Colours=colour)
quad_remesh = QuadRemesh(Mesh=construct_mesh, Settings={aqc=True, as=50, dhe=True, gci=0, null=False, pme=0, sa=0, tqc=2000})
deconstruct_mesh_2 = DeconstructMesh(Mesh=quad_remesh)  # -> Vertices, Faces, Colours, Normals
relay = Relay()
colour_2 = Colour(deconstruct_mesh_2.Normals)
construct_mesh_2 = ConstructMesh(Vertices=deconstruct_mesh_2.Vertices, Faces=deconstruct_mesh_2.Faces, Colours=colour_2)
face_normals = FaceNormals(Mesh=construct_mesh_2)  # -> Centers, Normals
line_sdl = LineSDL(Start=face_normals.Centers, Direction=face_normals.Normals, Length=Slider(10, range=1..10))
maze = Maze(Mesh=construct_mesh_2, Seed=seed)
end_points = EndPoints(Curve=line_sdl)  # -> Start, End
join_curves = JoinCurves(Curves=maze, Preserve=False)
point_2 = Point(end_points.End)
explode = Explode(Curve=join_curves, Recursive=True)  # -> flatten(Segments), Vertices
sort_list = SortList(Keys=point_2, ValuesValuesA=point_2)  # -> Keys, flatten(ValuesValuesA)
random_reduce = RandomReduce(List=sort_list.ValuesValuesA, Reduction=Slider(1414, range=0..2000), Seed=seed)
curve = Curve(explode.Segments)
point_3 = Point(random_reduce)
first_last = FirstLast(List=curve)  # -> FirstValue, LastValue
sort_list_2 = SortList(Keys=point_3, ValuesValuesA=point_3)  # -> Keys, ValuesValuesA
proximity_3d = Proximity3D(Points=point_3, Group=Slider(4, range=1..10))  # -> Links, Topology
end_points_2 = EndPoints(Curve=first_last.FirstValue)  # -> Start, End
end_points_3 = EndPoints(Curve=first_last.LastValue)  # -> Start, End
curve_2 = Curve(flatten(proximity_3d.Links))
first_last_2 = FirstLast(List=sort_list_2.ValuesValuesA)  # -> FirstValue, LastValue
line = Line(StartPoint=end_points_2.Start, EndPoint=end_points_3.End)
line_2 = Line(StartPoint=first_last_2.FirstValue, EndPoint=first_last_2.LastValue)
number_slider = Slider(1, range=0..2)
shortest_walk = ShortestWalk(Curves=curve_2, WantedPath=line_2)  # -> ShortestWalk, Succession, Direction, Length
shortest_walk_2 = ShortestWalk(Curves=explode.Segments, WantedPath=line)  # -> ShortestWalk, Succession, Direction, Length
curve_3 = Curve(shortest_walk.ShortestWalk)
curve_4 = Curve(shortest_walk_2.ShortestWalk)
mesh_area = MeshArea(Mesh=construct_mesh_2)  # -> Area, Centroid
pipe = Pipe(Curve=curve_3, Radius=tube, Caps=number_slider)
pipe_2 = Pipe(Curve=curve_4, Radius=tube, Caps=number_slider)
end_points_4 = EndPoints(Curve=curve_4)  # -> Start, End

# ---- group: RH_OUT:mesh
mesh = Mesh(construct_mesh_2)

# ---- group: RH_OUT:number1
number = Number(mesh_area.Area)

# ---- group: RH_OUT:brep
brep = Brep([pipe_2, pipe])

# ---- group: RH_OUT:number2
number_2 = Number(shortest_walk.Length)

# ---- group: RH_OUT:number3
number_3 = Number(shortest_walk_2.Length)

# ---- group: RH_OUT:point
start_point = Point(end_points_4.Start)

# ---- group: RH_Out:number4
end_point = Point(end_points_4.End)

# ---- group: RH_OUT:curve
curve_5 = Curve([curve_2, curve])
