# Grasshopper definition perlin noise simple.gh (Grasshopper 1.0.7)
# plug-ins: Noise 4D, Parakeet, Shortest Walk in Gh, treesloth01, Kangaroo2 Components

# ---- group: RH_IN: radius
radius = Slider(20, range=1..100)

# ---- group: RH_IN:count
count = Slider(52, range=1..100)

# ---- group: RH_IN:time
perlin_time = Slider(8.59, range=0..10)

# ---- group: RH_IN:scale
perlin_scale = Slider(0.08, range=0..0.1)

# ---- group: RH_IN:seed
maze_seed = Slider(30, range=0..100)

# ---- group: RH_IN:tube
radius_of_tube = Slider(0.5, range=0..1)

# ----
radius_2 = GetNumber(radius, AtLeast=1, AtMost=1, Maximum=1.797693135e+308, Minimum=-1.797693135e+308)
count_2 = GetNumber(count, AtLeast=1, AtMost=1, Maximum=1.797693135e+308, Minimum=-1.797693135e+308)
time = GetNumber(perlin_time, AtLeast=1, AtMost=1, Maximum=1.797693135e+308, Minimum=-1.797693135e+308)
scale = GetNumber(perlin_scale, AtLeast=1, AtMost=1, Maximum=1.797693135e+308, Minimum=-1.797693135e+308)
seed = GetNumber(maze_seed, AtLeast=1, AtMost=1, Maximum=1.797693135e+308, Minimum=-1.797693135e+308)
tube = GetNumber(radius_of_tube, AtLeast=1, AtMost=1, Maximum=1.797693135e+308, Minimum=-1.797693135e+308)
point = Point(Point(0, 0, 0))
mesh_sphere = MeshSphere(Base=point, Radius=radius_2, UCount=count_2, VCount=count_2)
deconstruct_mesh = DeconstructMesh(Mesh=mesh_sphere)  # -> Vertices, Faces, Colours, Normals
perlinnoise = PerlinNoise(Values=deconstruct_mesh.Vertices, Time=time, Scale=scale)
multiplication = Multiplication(A=deconstruct_mesh.Normals, B=perlinnoise)
multiplication_2 = Multiplication(A=multiplication, B=Slider(6, range=0..100))
move = Move(Geometry=deconstruct_mesh.Vertices, Motion=multiplication_2)  # -> Geometry, Transform
colour = Colour(deconstruct_mesh.Normals)
construct_mesh = ConstructMesh(Vertices=move.Geometry, Faces=deconstruct_mesh.Faces, Colours=colour)
maze = Maze(Mesh=construct_mesh, Seed=seed)
join_curves = JoinCurves(Curves=maze, Preserve=False)
explode = Explode(Curve=join_curves, Recursive=True)  # -> flatten(Segments), Vertices
curve = Curve(explode.Segments)
first_last = FirstLast(List=curve)  # -> FirstValue, LastValue
end_points = EndPoints(Curve=first_last.FirstValue)  # -> Start, End
end_points_2 = EndPoints(Curve=first_last.LastValue)  # -> Start, End
line = Line(StartPoint=end_points.Start, EndPoint=end_points_2.End)
shortest_walk = ShortestWalk(Curves=explode.Segments, WantedPath=line)  # -> ShortestWalk, Succession, Direction, Length
curve_2 = Curve(shortest_walk.ShortestWalk)
merge = Merge(Data2=curve)  # -> flatten(Result)
curvepoint = PointOnCurve(merge, parameter=0.5)
pt = ConstructPoint(XCoordinate=0, YCoordinate=0, ZCoordinate=0)
relay = Relay()
pull = PullPoint(Point=curvepoint, Geometry=pt, ClosestOnly=True)  # -> ClosestPoint, Distance
bnd = Bounds(Numbers=pull.Distance)
remap = RemapNumbers(Value=pull.Distance, Source=bnd, Target=Domain(0, 1))  # -> Mapped, Clipped
multipipe = MultiPipe(
    Curves=curve_2,
    NodeSize=tube,
    EndOffset=1,
    StrutSize=Slider(0.412, range=0..2),
    Segment=0,
    KinkAngle=tube,
    CubeFit=0,
    Caps=Slider(1, range=0..2))
end_points_3 = EndPoints(Curve=curve_2)  # -> Start, End
gradient = Gradient(
    LowerLimit=0,
    UpperLimit=1,
    Parameter=remap.Mapped,
    stops=[0.1: RGB(236, 27, 60), 0.2: RGB(210, 0, 118), 0.3: RGB(103, 0, 120), 0.4: RGB(39, 72, 161), 0.5: RGB(1, 192, 229), 0.6: RGB(18, 178, 90), 0.7: RGB(79, 186, 8), 0.8: RGB(220, 237, 32), 0.9: RGB(247, 159, 20), 1: RGB(243, 57, 0)])
meshsubd = MeshFromSubD(SubD=multipipe, Density=2)
deconstruct_mesh_2 = DeconstructMesh(Mesh=multipipe)  # -> Vertices, Faces, Colours, Normals
mesh = Mesh(construct_mesh)
c_script = CSharpScript(crv=curve_2, length=shortest_walk.Length)  # -> L; inputs crv: Curve, length: String
# ---------- c_script: C# ----------
    crv.SetUserString("length", length);
    L = crv;
# ---------- end c_script ----------
bnd_2 = Bounds(Numbers=deconstruct_mesh_2.Vertices)
remap_2 = RemapNumbers(Value=deconstruct_mesh_2.Vertices, Source=bnd_2, Target=Domain(0, 1))  # -> Mapped, Clipped

# ---- group: RH_OUT:number2
number = Number(c_script)  # disabled

# ---- group: RH_OUT:point
start_point = Point([end_points_3.End, end_points_3.Start])  # disabled

# ----
gradient_2 = Gradient(
    LowerLimit=0,
    UpperLimit=1,
    Parameter=remap_2.Mapped,
    stops=[0: RGB(234, 38, 0), 0.25: RGB(234, 126, 0), 0.5: RGB(254, 244, 84), 0.75: RGB(173, 203, 249), 1: RGB(75, 107, 169)])
construct_mesh_2 = ConstructMesh(Vertices=deconstruct_mesh_2.Vertices, Faces=deconstruct_mesh_2.Faces, Colours=gradient_2)
scale_2 = Scale(Geometry=mesh, Center=Point(0, 0, 0), Factor=Slider(0.524, range=0..2))  # -> Geometry, Transform
c_script_2 = CSharpScript(crv=merge, color=gradient)  # -> out, A; inputs crv: Curve, color: Color
# ---------- c_script_2: C# ----------
    var c = color.R + "," + color.G + "," + color.B;
    crv.SetUserString("color", c);
    A = crv;
# ---------- end c_script_2 ----------
clean = CombineClean(Meshes=construct_mesh_2)
medges = MeshEdges(Mesh=scale_2.Geometry)  # -> NakedEdges, InteriorEdges, NonManifoldEdges
join = JoinCurves(Curves=medges.InteriorEdges, Preserve=False)

# ---- group: RH_OUT:edges
curve_3 = Curve(flatten(c_script_2.A))

# ---- group: RH_OUT:curve
curve_4 = Curve(join)

# ---- group: RH_OUT:mesh
mesh_2 = Mesh(flatten([clean, scale_2.Geometry]))
